# Grasshopper definition gh_script_v1.gh (Grasshopper 1.0.8)
# Copyright: MIT License © 2025 M. Johanes

agent_list = Agent_list(enable=Toggle(True))  # -> out, agents
panel = Panel(agent_list.agents)
session_create = Session_create(user_id="mjohanes@user.id", enable=Toggle(True))
panel_2 = Panel(session_create)
saved_session = Text(session_create)
panel_3 = Panel(saved_session)

building = GeometryPipeline(
    GroupByLayer=False,
    GroupByType=False,
    IncludeHidden=True,
    IncludeLocked=True,
    LayerFilter="building",
    NameFilter="*",
    SublayerFiltering=True,
    TypeFilter=4)
windows = GeometryPipeline(
    GroupByLayer=False,
    GroupByType=False,
    IncludeHidden=True,
    IncludeLocked=True,
    LayerFilter="windows",
    NameFilter="*",
    SublayerFiltering=True,
    TypeFilter=4)
entrance = GeometryPipeline(
    GroupByLayer=False,
    GroupByType=False,
    IncludeHidden=True,
    IncludeLocked=True,
    LayerFilter="entrance",
    NameFilter="*",
    SublayerFiltering=True,
    TypeFilter=4)
floors = GeometryPipeline(
    GroupByLayer=False,
    GroupByType=False,
    IncludeHidden=True,
    IncludeLocked=True,
    LayerFilter="floor",
    NameFilter="*",
    SublayerFiltering=True,
    TypeFilter=4)
curve = Curve(building)
curve_2 = Curve(windows)
curve_3 = Curve(entrance)
curve_4 = Curve(floors)
to_json = To_json(geometry=curve, name="building")
to_json_2 = To_json(geometry=curve_2, name="window")
to_json_3 = To_json(geometry=curve_3, name="entrance")
to_json_4 = To_json(geometry=curve_4, name="floor")
merge = Merge(Data1=to_json, Data2=to_json_4, Data3=to_json_2, Data4=to_json_3)

# ---- group: SESSION LIST
session_list = Session_list(enable=Toggle(False))  # -> out, sessions
panel_4 = Panel(session_list.sessions)

# ---- group: RUN_agents
number_slider = Slider(5, range=0..5)
evaluate = Evaluate(Expression="If(x>0, true, false)", x=number_slider)

# ---- group: SESSION REMOVE
session_delete = Session_delete(sessions=session_list.sessions, enable=Toggle(False))
panel_5 = Panel(session_delete)

# ---- group: KNOWLEDGE UPLOAD
panel_6 = Panel("base knowledge for design reasoning of edge-computing facade integration")
file_path = FilePath("/Users/mjohanes/PythonProject/gh_aiagents/knowledge/edge_computing_facade.md")
knowledge_upload = Knowledge_upload(filepath=file_path, name="ede-computing facade design integration", description=panel_6, enable=Toggle(False))  # -> out, response
panel_7 = Panel(knowledge_upload.response)

# ---- group: KNOWLEDGE AGENT
agent_runs = Agent_runs(agent_id="knowledge-agent", message="tell me about the type of energy module in facade", enable=Toggle(False))  # -> out, session_id_2, response
panel_8 = Panel(agent_runs.response)

# ---- group: KNOWLEDGE LIST
knowledge_list = Knowledge_list(enable=Toggle(False))  # -> out, contents
panel_9 = Panel(knowledge_list.contents)

# ---- group: MEMORY MANAGER
list_memories = List_memories(user_id="mjohanes@user.id", enable=Toggle(False))  # -> out, memories
delete_memories = DeleteMemories(memories=list_memories.memories, user_id="mjohanes@user.id", enable=Toggle(False))
panel_10 = Panel(list_memories.memories)
panel_11 = Panel(delete_memories)

# ---- group: KNOWLEDGE REMOVE
list_item = ListItem(List=knowledge_list.contents, Index=0, Wrap=True)
remove_knowledge = Remove_knowledge(content=list_item, enable=Toggle(False))
panel_12 = Panel(remove_knowledge)

# ---- group: KNOWLEDGE REMOVE ALL
knowledge_rem_all = Knowledge_rem_all(enable=Toggle(False))
panel_13 = Panel(knowledge_rem_all)

# ----
list_memories_2 = List_memories(user_id="mjohanes@user.id", topic="generated_grid", enable=evaluate)  # -> out, memories
list_memories_3 = List_memories(user_id="mjohanes@user.id", topic="evaluation", enable=evaluate)  # -> out, memories
panel_14 = Panel(list_memories_2.memories)
panel_15 = Panel(list_memories_3.memories)

memory_read = Memory_read(memory_string=list_memories_2.memories, data_key="generated_grid")  # -> iteration, data
memory_read_2 = Memory_read(memory_string=list_memories_3.memories, data_key="evaluation")  # -> iteration, data

sort_list = SortList(Keys=memory_read.iteration, ValuesValuesA=memory_read.data, ValuesB=memory_read_2.data)  # -> Keys, ValuesValuesA, ValuesB
json_create = Json_create(key="evaluation", val=sort_list.ValuesB)
json_create_2 = Json_create(key="iteration", val=sort_list.Keys)
json_create_3 = Json_create(key="generated_grid", val=sort_list.ValuesValuesA)
python_3_script = Python3Script(iterations=json_create_2, gen_grids=json_create_3, evaluations=json_create)  # -> out, merged_json; inputs iterations: list, gen_grids: list, evaluations: list
# ---------- python_3_script: Python ----------
import json



merged = []

try:
    for a, b, c in zip(iterations, gen_grids, evaluations):
        a = json.loads(a)
        b = json.loads(b)
        c = json.loads(c)
        
        # merge dicts
        merged_dict = {**a, **b, **c}
        merged.append(merged_dict)

    # If you want a single JSON string:

    merged_json = json.dumps(merged)
except:
    merged_json = "{}"
# ---------- end python_3_script ----------
json_create_4 = Json_create(key="previous_iterations", val=python_3_script.merged_json)  # -> flatten(jsons)

panel_16 = Panel("""Task Generate an orthogonal planning grid for the given façade geometry, enriched with dynamic diagonal elements.
1. Alignment
	•	Snap all primary grid lines precisely to the provided input elements and to the façade’s bounding geometry.
	•	Respect all given reference points, edges, and axes.
2. Primary Grid: Orthogonal Structure
	•	Use horizontal and vertical lines as the main structural grid.
	•	Establish a clear modular logic (primary vs. secondary grid lines, readable hierarchy).
	•	Aim for a visually balanced, asymmetrical composition.
3. Dynamic Diagonal Elements
	•	Introduce diagonal lines as secondary/compositional elements that interact with the orthogonal grid.
	•	Use diagonals to create rhythm, directionality, and dynamic tension, not random clutter.
	•	Ensure diagonals reinforce or articulate key alignments (openings, structural bays, key façade edges), rather than breaking them arbitrarily.
	•	Limit diagonal complexity so the overall system remains legible and rational.
4. Spacing & Density
	•	Maintain rational spacing across the grid; avoid overly tight, unreadable clusters.
	•	Vary line density locally (both orthogonal and diagonal) to emphasize specific zones and enhance composition.
	•	Preserve overall proportional harmony despite local variations.
5. Novelty Constraint
	•	Do not replicate or closely imitate any previous grid from this session.
	•	Propose a clearly distinct, well-balanced variation that still conforms to all rules above.
6. Optimization Objective
	•	Prefer solutions that would score highly on:
	◦	Architectural clarity and legibility
	◦	Proportional coherence
	◦	Visual balance between orthogonal order and diagonal dynamism.""")
json_from_list = Json_from_list(input_strings=merge)
json_create_5 = Json_create(key="iteration", val=number_slider)
json_create_6 = Json_create(key="prompt", val=panel_16)
json_create_7 = Json_create(key="elements", val=json_from_list)  # -> flatten(jsons)
merge_2 = Merge(Data1=json_create_5, Data2=json_create_6, Data3=json_create_7, Data4=json_create_4)
merge_3 = Merge(Data1=json_create_5, Data2=json_create_6, Data3=json_create_7)
param_viewer = ParamViewer(json_create_5)
param_viewer_2 = ParamViewer(json_create_7)
message_construct = Message_construct(jsons_list=merge_3)
message_construct_2 = Message_construct(jsons_list=merge_2)
list_item_2 = ListItem(List=agent_list.agents, Index=1, Wrap=True)
agent_runs_2 = Agent_runs(agent_id=list_item_2, session_id=panel_2, user_id="mjohanes@user.id", message=message_construct_2, enable=evaluate)  # -> out, session_id_2, response
json_create_8 = Json_create(key="grid_generation_prompt", val=message_construct)
json_create_9 = Json_create(key="generated_grid", val=agent_runs_2.response)

python_3_script_2 = Python3Script(input_jsons=agent_runs_2.response)  # -> out, grid_lines; inputs input_jsons: String
# ---------- python_3_script_2: Python ----------
#! python 3
# venv: gh_agno

import Rhino.Geometry as rg
from schema.rhino_converters import to_rhino
from schema.geometry import Line
import json, requests
from ghpythonlib import treehelpers as th

grid_lines = []
if input_jsons:
    grid_json = json.loads(input_jsons)
    lines = grid_json.get("lines", [])
    for l in lines:
        grid_lines.append(Line.model_validate(l))


grid_lines = [to_rhino(l) for l in grid_lines]
# ---------- end python_3_script_2 ----------
number_slider_2 = Slider(0.2, range=0..1)
extend_curve = ExtendCurve(Curve=python_3_script_2.grid_lines, Type=0, Start=number_slider_2, End=number_slider_2)
boundary_surfaces = BoundarySurfaces(Edges=curve)
curve_5 = Curve(extend_curve)
surface_split = SurfaceSplit(Surface=boundary_surfaces, Curves=curve_5)

merge_4 = Merge(Data1=json_create_5, Data2=json_create_9)
message_construct_3 = Message_construct(jsons_list=merge_4)
save_memory = Save_memory(user_id="mjohanes@user.id", topic="generated_grid", memory=message_construct_3, enable=evaluate)  # -> out, saved_memory
panel_17 = Panel(save_memory.saved_memory)

list_length = ListLength(List=surface_split)
random = Random(Range=Domain(0, 1), Number=list_length, Seed=2)
random_2 = Random(Range=Domain(0, 1), Number=list_length, Seed=3)
random_3 = Random(Range=Domain(0, 1), Number=list_length, Seed=4)
colour_rgb_f = ColourRGBF(Alpha=1, Red=random, Green=random_2, Blue=random_3)
custom_preview = CustomPreview(Geometry=surface_split, Material=colour_rgb_f)

area = Area(Geometry=surface_split)  # -> flatten(Area), flatten(Centroid)
brep_edges = BrepEdges(Brep=surface_split)  # -> Naked, Interior, NonManifold
join_curves = JoinCurves(Curves=brep_edges.Naked, Preserve=False)  # -> flatten(Curves)
json_create_10 = Json_create(key="area", val=area.Area)  # -> flatten(jsons)
to_json_5 = To_json(geometry=join_curves, name="grid_panel")  # -> flatten(json_2)

json_from_list_2 = Json_from_list(input_strings=to_json_5)

panel_18 = Panel("""Task
Evaluate the proposed façade panel configuration for its ability to support architectural integration of edge-computing systems and its alignment with existing façade elements.

Scope & Inputs
- Proposed panel grid and types.
- Any known existing elements: structural grid (columns, slab edges), mullions/transoms, spandrels, openings (doors/windows), balconies/rails, signage, service risers, gutters/drains, heritage features, and MEP penetrations.
- If existing elements are not provided, infer likely constraints from typical building logic and flag assumptions.

Objectives (score each; see weights)
1) Modularity (25%)
- Panels follow a rational modular grid enabling easy replacement, upgrade, and standardized mounting of compute/energy units.
- Consistent module logic beats mere geometric uniformity.
- Clear service corridors / cable trunks; repeatable connectors and fixing lines.

2) Integration Efficiency (25%)
- Balanced surface coverage vs. technical feasibility.
- Panel sizes accommodate embedded PV modules, sensors, vents, micro-inverters without excessive fragmentation.
- Logical clustering of devices; short, serviceable cable runs; thermal and ventilation paths are feasible.

3) Proportion & Maintainability (20%)
- Near-rectangular, well-proportioned panels that aid fabrication and safe access.
- Avoid overly narrow/irregular panels that complicate installation or maintenance.
- Evident access strategy (front-removable/hinged/rear-service), safe reach from maintenance zones.

4) Alignment with Existing Elements (30%)
- Verticals/horizontals align with structural bays, slab edges, and major mullions where practical.
- Panel seams do not cut through doors/windows, louvres, or heritage features.
- No clashes with balconies, signage, gutters, downpipes, sensors/cameras already in place.
- MEP penetrations and drainage points respected; egress and daylight not degraded.
- Tolerance strategy present (slip joints, adjustable brackets) for survey variances and phased retrofit.
- Street-facing vernacular cues (if applicable) acknowledged without pastiche.""")
json_create_11 = Json_create(key="grid_panels", val=json_from_list_2)  # -> flatten(jsons)
json_create_12 = Json_create(key="prompt", val=panel_18)
merge_5 = Merge(Data1=json_create_12, Data2=json_create_8, Data3=json_create_9, Data4=json_create_11, Data5=json_create_10)
message_construct_4 = Message_construct(jsons_list=merge_5)
list_item_3 = ListItem(List=agent_list.agents, Index=2, Wrap=True)
agent_runs_3 = Agent_runs(
    agent_id=list_item_3,
    session_id=agent_runs_2.session_id_2,
    user_id="mjohanes@user.id",
    message=message_construct_4,
    enable=evaluate)  # -> out, session_id_2, response
json_create_13 = Json_create(key="evaluation", val=agent_runs_3.response)
panel_19 = Panel(agent_runs_3.response)

merge_6 = Merge(Data1=json_create_5, Data2=json_create_11)
message_construct_5 = Message_construct(jsons_list=merge_6)
save_memory_2 = Save_memory(user_id="mjohanes@user.id", topic="generated_panels", memory=message_construct_5, enable=evaluate)  # -> out, saved_memory
panel_20 = Panel(save_memory_2.saved_memory)

merge_7 = Merge(Data1=json_create_5, Data2=json_create_13)
message_construct_6 = Message_construct(jsons_list=merge_7)
save_memory_3 = Save_memory(user_id="mjohanes@user.id", topic="evaluation", memory=message_construct_6, enable=evaluate)  # -> out, saved_memory
panel_21 = Panel(save_memory_3.saved_memory)

# ==== cluster To_json: convert basic rhino geometry to json based representation
name = ClusterInput()
geometry = ClusterInput()
name_2 = Text(name)
geometry_2 = Geometry(geometry)
name_3 = Python3Script(geoms=geometry_2, name=name_2)  # -> out, names; inputs geoms: list, name: String
# ---------- name_3: Python ----------
#! python 3
# venv: gh_agno

names = []
for i in range(len(geoms)):
    names.append(f'{name}-{i+1:02d}')
# ---------- end name_3 ----------
to_json = Python3Script(geometry=geometry_2, name=name_3.names)  # -> out, json_string; inputs geometry: GeometryBase
# ---------- to_json: Python ----------
#! python 3
# venv: gh_agno
# requirements: pydantic

import json
import Rhino.Geometry as rg
from pydantic import ValidationError

# Import your Pydantic geometry schema
from schema.geometry import (
    Geometry,
    Point3d,
    Vector3d,
    Line,
    Plane,
    Polyline,
    Circle,
    Arc,
    Mesh,
    NurbsSurface,
    PlaneSurface,
    RevSurface
)

from schema.from_rhino import *

input_geometry = geometry



def convert_geometry_to_json(input_geometry, name=None):
    """
    Converts Rhino geometry to JSON string using schema.from_rhino.
    Raises:
        ValueError: if input is None
        TypeError: if geometry type is unsupported
    """
    if input_geometry is None:
        raise ValueError("No geometry provided — expected a Rhino.Geometry object.")
    try:
        pydantic_obj = from_rhino(input_geometry)
    except TypeError as e:
        raise TypeError(f"Unsupported geometry type: {type(input_geometry)}") from e
    except Exception as e:
        raise RuntimeError(f"Conversion failed for geometry {input_geometry}: {e}")

    if not isinstance(pydantic_obj, Geometry):
        raise TypeError(f"Conversion did not return a valid Geometry model (got {type(pydantic_obj)}).")

    # inject name:
    if name:
        pydantic_obj = pydantic_obj.model_copy(update={"id": name})
    # Serialize to JSON
    return pydantic_obj.model_dump_json()


try:
    input_geometry = geometry  # from GH Python input
except NameError:
    raise ValueError("Variable 'geometry' not found — define your input first.")

json_string = convert_geometry_to_json(input_geometry, name)
print(json_string)
# ---------- end to_json ----------
json = Text(to_json.json_string)
json_2 = ClusterOutput(json)

# ==== cluster Json_create: create key val json
key = ClusterInput()
val = ClusterInput()
python_3_script = Python3Script(key=key, val=val)  # -> out, jsons; inputs key: String, val: String
# ---------- python_3_script: Python ----------
#! python 3
# venv: gh_agno

import json

def format_floats(obj):
    if isinstance(obj, float):
        return round(obj, 2)
    elif isinstance(obj, list):
        return [format_floats(x) for x in obj]
    elif isinstance(obj, dict):
        return {k: format_floats(v) for k, v in obj.items()}
    else:
        return obj


if val:

    try:
        val = json.loads(val)
    except Exception:
        pass
    data = {key: format_floats(val)}
    jsons = json.dumps(data)
# ---------- end python_3_script ----------
jsons = ClusterOutput(python_3_script.jsons)

# ==== cluster Message_construct: create message for agent
jsons_list = ClusterInput()
message_construct = Python3Script(jsons_list=jsons_list)  # -> out, message; inputs jsons_list: list of String
# ---------- message_construct: Python ----------
#! python 3
# venv: gh_agno

import json



if jsons_list:
    message = {}
    for json_string in jsons_list:
        print(json_string)
        json_data = json.loads(json_string)
        for k, v in json_data.items():
            message[k] = v


    message = json.dumps(message)
# ---------- end message_construct ----------
message = ClusterOutput(message_construct.message)

# ==== cluster Agent_runs: run an agent
agent_id = ClusterInput()
session_id = ClusterInput()
user_id = ClusterInput()
message = ClusterInput()
enable = ClusterInput()
agent_runs = Python3Script(agent_id=agent_id, session_id=session_id, user_id=user_id, message=message, enable=enable)  # -> out, session_id, response; inputs agent_id: String, user_id: String, message: String, enable: Boolean
# ---------- agent_runs: Python ----------
#! python 3
# venv: gh_agno
# requirements: requests

import Rhino.Geometry as rg
from schema.rhino_converters import to_rhino
from schema.geometry import Line
import json, requests
from ghpythonlib import treehelpers as th

url = f"http://127.0.0.1:8000/agents/{agent_id}/runs"


payload = {}

if enable:
    if message:
        payload["message"]=message
    
    if session_id:
        payload["session_id"]=session_id


    if user_id:
        payload["user_id"]=user_id


    response = requests.post(url, data=payload)

    if response.status_code == 200:
        try:
            data = response.json()              # Parse JSON body
        except ValueError:
            print("Response was not valid JSON:")
    else:
        print(f"Error {response.status_code}: {response.text}")


    session_id = data.get("session_id", None)
    content = data.get("content", None)

    response = json.dumps(content)
# ---------- end agent_runs ----------
response = ClusterOutput(agent_runs.response)
session_id_2 = ClusterOutput(agent_runs.session_id)
out = ClusterOutput(agent_runs.out)

# ==== cluster Session_create: create new session id
user_id = ClusterInput()
enable = ClusterInput()
py3 = Python3Script(user_id=user_id, enable=enable)  # -> out, session_id; inputs user_id: String, enable: Boolean
# ---------- py3: Python ----------
#! python 3
# venv: gh_agno
# requirements: requests
import json, requests
from ghpythonlib import treehelpers as th

url_config = "http://127.0.0.1:8000/config"
url_session = "http://127.0.0.1:8000/sessions"

if enable:
    response = requests.get(url_config)

    if response.status_code == 200:
        try:
            data = response.json()              # Parse JSON body
        except ValueError:
            print("Response was not valid JSON:")
    else:
        print(f"Error {response.status_code}: {response.text}")

    db_id = data.get('databases')[0]
    print(db_id)




    params = {
        "type": "agent",
        "db_id": db_id
    }

    payload = {}

    print(user_id)

    if user_id:
        payload["user_id"] = user_id

    print(payload)

    response = requests.post(url_session, params=params, json=payload)


    if response.status_code == 201:
        try:
            data = response.json()              # Parse JSON body
        except ValueError:
            print("Response was not valid JSON:")
    else:
        print(f"Error {response.status_code}: {response.text}")
        

    session_id = data.get("session_id", None)
# ---------- end py3 ----------
session_id = ClusterOutput(py3.session_id)

# ==== cluster Save_memory: save input into memory
enable = ClusterInput()
user_id = ClusterInput()
memory = ClusterInput()
topic = ClusterInput()
py3 = Python3Script(user_id=user_id, topic=topic, memory=memory, enable=enable)  # -> out, saved_memory; inputs user_id: String, topic: String, memory: String, enable: Boolean
# ---------- py3: Python ----------
#! python 3
# venv: gh_agno

# requirements: requests
import json, requests
from ghpythonlib import treehelpers as th


url_config = "http://127.0.0.1:8000/config"
url_memories = "http://127.0.0.1:8000/memories"

if enable and memory and user_id and topic:
    response = requests.get(url_config)

    if response.status_code == 200:
        try:
            data = response.json()              # Parse JSON body
        except ValueError:
            print("Response was not valid JSON:")
    else:
        print(f"Error {response.status_code}: {response.text}")

    db_id = data.get('databases')[0]
    print(db_id)


    params = {"db_id":db_id}


    data = {"memory":memory,
            "user_id":user_id,
            "topics":[topic]}


    
    response = requests.post(url_memories, params=params, json=data)


    if response.status_code != 200:
        print(f"Request failed ({response.status_code}): {response.text}")
    

    data = response.json()
    
    

    saved_memory = json.dumps(data)
# ---------- end py3 ----------
saved_memory = ClusterOutput(py3.saved_memory)
out = ClusterOutput(py3.out)

# ==== cluster List_memories: list all memories
topic = ClusterInput()
enable = ClusterInput()
search_content = ClusterInput()
agent_id = ClusterInput()
user_id = ClusterInput()
py3 = Python3Script(user_id=user_id, agent_id=agent_id, search_content=search_content, topic=topic, enable=enable)  # -> out, memories; inputs topic: String, enable: Boolean
# ---------- py3: Python ----------
#! python 3
# venv: gh_agno
# requirements: requests
import json, requests
from ghpythonlib import treehelpers as th


url_config = "http://127.0.0.1:8000/config"
url_memories = "http://127.0.0.1:8000/memories"

if enable:
    response = requests.get(url_config)

    if response.status_code == 200:
        try:
            data = response.json()              # Parse JSON body
        except ValueError:
            print("Response was not valid JSON:")
    else:
        print(f"Error {response.status_code}: {response.text}")

    db_id = data.get('databases')[0]
    print(db_id)


    params = {}

    if user_id:
        params["user_id"] = user_id

    if agent_id:
        params["agent_id"] = agent_id

    if search_content:
        params["search_content"] = search_content

    if topic:
        params["topics"]=[topic]
    
    params["db_id"] = db_id
    params["limit"] = 20
    params["page"] = 1
    params["sort_by"] = "updated_at"
    params["sort_order"] = "desc"


    # Make the GET request
    all_memories = []

    while True:
        response = requests.get(url_memories, params=params)


        if response.status_code != 200:
            print(f"Request failed ({response.status_code}): {response.text}")
            break
        

        data = response.json()
        items = data.get("data", [])
        meta = data.get("meta", {})


        if not items:
            print("No more memories found.")
            break

        
        all_memories.extend(items)

        total_pages = meta.get("total_pages", 0)
        current_page = meta.get("page", params["page"])

        # Stop when we reach the last page
        if current_page >= total_pages:
            break

        # Move to next page
        params["page"] = current_page + 1

    print(all_memories)


    memories = [json.dumps(d) for d in all_memories]
# ---------- end py3 ----------
memories = ClusterOutput(py3.memories)
out = ClusterOutput(py3.out)

# ==== cluster DeleteMemories: delete memories
memories = ClusterInput()
enable = ClusterInput()
user_id = ClusterInput()
py3 = Python3Script(memories=memories, user_id=user_id, enable=enable)  # -> out; inputs memories: list of String, user_id: String, enable: Boolean
# ---------- py3: Python ----------
#! python 3
# venv: gh_agno
# requirements: requests
import json, requests
from ghpythonlib import treehelpers as th


url_config = "http://127.0.0.1:8000/config"
url_memories = "http://127.0.0.1:8000/memories"

if enable:
    response = requests.get(url_config)

    if response.status_code == 200:
        try:
            data = response.json()              # Parse JSON body
        except ValueError:
            print("Response was not valid JSON:")
    else:
        print(f"Error {response.status_code}: {response.text}")

    db_id = data.get('databases')[0]
    print(db_id)


    params = {"db_id":db_id}

    if enable and memories and user_id:
        memories = [json.loads(m) for m in memories]
        memory_ids = [d["memory_id"] for d in memories]
        
        data={"memory_ids":memory_ids,
                "user_id":user_id}

        response = requests.delete(url_memories, params=params, json=data)
        if response.status_code != 204:
            print(f"Request failed ({response.status_code}): {response.text}")
            
        print("Memories deleted successfully")
# ---------- end py3 ----------
out = ClusterOutput(py3)

# ==== cluster Json_from_list: create json list from list of strings
input_strings = ClusterInput()
py3 = Python3Script(input_strings=input_strings)  # -> out, json_string; inputs input_strings: list of String
# ---------- py3: Python ----------
#! python 3
# venv: gh_agno

import json



if input_strings:
    vals = []

    for s in input_strings:
        try:
            s = json.loads(s)
        except:
            pass
        vals.append(s)


    json_string = json.dumps(vals)
# ---------- end py3 ----------
json_string = ClusterOutput(py3.json_string)

# ==== cluster Session_list: list all sessions
user_id = ClusterInput()
enable = ClusterInput()
py3 = Python3Script(user_id=user_id, enable=enable)  # -> out, sessions; inputs enable: Boolean
# ---------- py3: Python ----------
#! python 3
# venv: gh_agno
# requirements: requests
import json, requests
from ghpythonlib import treehelpers as th


url_config = "http://127.0.0.1:8000/config"
url_sessions = "http://127.0.0.1:8000/sessions"

if enable:
    response = requests.get(url_config)

    if response.status_code == 200:
        try:
            data = response.json()              # Parse JSON body
        except ValueError:
            print("Response was not valid JSON:")
    else:
        print(f"Error {response.status_code}: {response.text}")

    db_id = data.get('databases')[0]
    print(db_id)


    params = {"type":"agent"}

    if user_id:
        params["user_id"] = user_id

    
    params["db_id"] = db_id
    params["limit"] = 20
    params["page"] = 1
    params["sort_by"] = "updated_at"
    params["sort_order"] = "desc"


    # Make the GET request
    all_sessions = []

    while True:
        response = requests.get(url_sessions, params=params)


        if response.status_code != 200:
            print(f"Request failed ({response.status_code}): {response.text}")
            break
        

        data = response.json()
        items = data.get("data", [])
        meta = data.get("meta", {})


        if not items:
            print("No more session found.")
            break

        
        all_sessions.extend(items)

        total_pages = meta.get("total_pages", 0)
        current_page = meta.get("page", params["page"])

        # Stop when we reach the last page
        if current_page >= total_pages:
            break

        # Move to next page
        params["page"] = current_page + 1

    # print(all_memories)


    sessions = [json.dumps(d) for d in all_sessions]
# ---------- end py3 ----------
out = ClusterOutput(py3.out)
sessions = ClusterOutput(py3.sessions)

# ==== cluster Session_delete: delete sessions
sessions = ClusterInput()
enable = ClusterInput()
py3 = Python3Script(sessions=sessions, enable=enable)  # -> out; inputs sessions: list of String, enable: Boolean
# ---------- py3: Python ----------
#! python 3
# venv: gh_agno
# requirements: requests
import json, requests
from ghpythonlib import treehelpers as th


url_config = "http://127.0.0.1:8000/config"
url_sessions = "http://127.0.0.1:8000/sessions"

if enable:
    response = requests.get(url_config)

    if response.status_code == 200:
        try:
            data = response.json()              # Parse JSON body
        except ValueError:
            print("Response was not valid JSON:")
    else:
        print(f"Error {response.status_code}: {response.text}")

    db_id = data.get('databases')[0]
    print(db_id)


    params = {"db_id":db_id, "type":"agent"}

    if enable and sessions:
        sessions = [json.loads(m) for m in sessions]
        session_ids = [d["session_id"] for d in sessions]
        session_types = ["agent" for d in sessions]
        
        data={"session_ids":session_ids,
                "session_types":session_types}

        response = requests.delete(url_sessions, params=params, json=data)
        if response.status_code != 204:
            print(f"Request failed ({response.status_code}): {response.text}")
            
        print("Sessions deleted successfully")
# ---------- end py3 ----------
out = ClusterOutput(py3)

# ==== cluster Knowledge_list: list all knowledge
enable = ClusterInput()
py3 = Python3Script(enable=enable)  # -> out, contents; inputs enable: Boolean
# ---------- py3: Python ----------
#! python 3
# venv: gh_agno
# requirements: requests
import json, requests
from ghpythonlib import treehelpers as th


url_config = "http://127.0.0.1:8000/config"
url_contents = "http://127.0.0.1:8000/knowledge/content"

if enable:
    response = requests.get(url_config)

    if response.status_code == 200:
        try:
            data = response.json()              # Parse JSON body
        except ValueError:
            print("Response was not valid JSON:")
    else:
        print(f"Error {response.status_code}: {response.text}")

    db_id = data["knowledge"]["dbs"][0]["db_id"]
    print(db_id)



    params = {"type":"agent"}


    
    params["db_id"] = db_id
    params["limit"] = 20
    params["page"] = 1
    params["sort_by"] = "created_at"
    params["sort_order"] = "desc"


    # Make the GET request
    all_contents = []

    while True:
        response = requests.get(url_contents, params=params)


        if response.status_code != 200:
            print(f"Request failed ({response.status_code}): {response.text}")
            break
        

        data = response.json()
        items = data.get("data", [])
        meta = data.get("meta", {})


        if not items:
            print("No more contents found.")
            break

        
        all_contents.extend(items)

        total_pages = meta.get("total_pages", 0)
        current_page = meta.get("page", params["page"])

        # Stop when we reach the last page
        if current_page >= total_pages:
            break

        # Move to next page
        params["page"] = current_page + 1

    # print(all_memories)


    contents = [json.dumps(d) for d in all_contents]

    print(contents)
# ---------- end py3 ----------
contents = ClusterOutput(py3.contents)
out = ClusterOutput(py3.out)

# ==== cluster Knowledge_upload: upload file to knowledge base
description = ClusterInput()
enable = ClusterInput()
name = ClusterInput()
filepath = ClusterInput()
py3 = Python3Script(filepath=filepath, name=name, description=description, enable=enable)  # -> out, response; inputs filepath: String, enable: Boolean
# ---------- py3: Python ----------
#! python 3
# venv: gh_agno
# requirements: requests
import os
import json, requests
from ghpythonlib import treehelpers as th
import mimetypes



url_config = "http://127.0.0.1:8000/config"
url_contents = "http://127.0.0.1:8000/knowledge/content"

if enable and filepath:
    response = requests.get(url_config)

    if response.status_code == 200:
        try:
            data = response.json()              # Parse JSON body
        except ValueError:
            print("Response was not valid JSON:")
    else:
        print(f"Error {response.status_code}: {response.text}")

    db_id = data["knowledge"]["dbs"][0]["db_id"]
    print(db_id)



    params = {"db_id":db_id}

    payload = {}
    if name:
        payload["name"]=name


    mime_type, _ = mimetypes.guess_type(filepath)
    if mime_type is None:
        mime_type = "application/octet-stream" 
    
    print(mime_type)
    # open the file you want to upload
    with open(filepath, "rb") as f:
        filename = os.path.basename(filepath)
        files = {
            "file": (filename, f, mime_type)  # (filename, file object)
        }

        data = {
            "name": "",
            "description": "",
            "url": "",
            "metadata": "",
            "text_content": "",
            "reader_id": "",
            "chunker": "",
        }

        if name:
            data["name"] = name
        if description:
            data["description"] = description

        headers = {
            "accept": "application/json",
        }

        response = requests.post(url_contents, params=params, headers=headers, data=data, files=files)

    print(response.status_code)
    print(response.json())
# ---------- end py3 ----------
out = ClusterOutput(py3.out)
response = ClusterOutput(py3.response)

# ==== cluster Agent_list: list all available agents
enable = ClusterInput()
list_agents = Python3Script(enable=enable)  # -> out, data, agents; inputs enable: Boolean
# ---------- list_agents: Python ----------
# requirements: requests
import json, requests
from ghpythonlib import treehelpers as th

url = "http://127.0.0.1:8000/agents"


if enable:
    response = requests.get(url)


    if response.status_code == 200:
        try:
            data = response.json()              # Parse JSON body
        except ValueError:
            print("Response was not valid JSON:")
    else:
        print(f"Error {response.status_code}: {response.text}")

    agents = []
    for item in data:
        agents.append(item.get('id', None))


    agents = th.list_to_tree(agents)
# ---------- end list_agents ----------
out = ClusterOutput(list_agents.out)
agents = ClusterOutput(list_agents.agents)

# ==== cluster Knowledge_rem_all: remove all content in knowledge base
enable = ClusterInput()
py3 = Python3Script(enable=enable)  # -> out; inputs enable: Boolean
# ---------- py3: Python ----------
#! python 3
# venv: gh_agno
# requirements: requests
import json, requests
from ghpythonlib import treehelpers as th


url_config = "http://127.0.0.1:8000/config"
url_contents = "http://127.0.0.1:8000/knowledge/content"

if enable:
    response = requests.get(url_config)

    if response.status_code == 200:
        try:
            data = response.json()              # Parse JSON body
        except ValueError:
            print("Response was not valid JSON:")
    else:
        print(f"Error {response.status_code}: {response.text}")

    db_id = data["knowledge"]["dbs"][0]["db_id"]
    print(db_id)


    params = {"db_id":db_id}


    response = requests.delete(url_contents, params=params)
    if response.status_code != 200:
        print(f"Request failed ({response.status_code}): {response.text}")
        
    print("Knowledge removed successfully")
# ---------- end py3 ----------
out = ClusterOutput(py3)

# ==== cluster Remove_knowledge: remove selected knowledge content
content = ClusterInput()
enable = ClusterInput()
py3 = Python3Script(content=content, enable=enable)  # -> out; inputs content: String, enable: Boolean
# ---------- py3: Python ----------
#! python 3
# venv: gh_agno
# requirements: requests
import json, requests
from ghpythonlib import treehelpers as th


url_config = "http://127.0.0.1:8000/config"
url_contents = "http://127.0.0.1:8000/knowledge/content"

if enable and content:

    content = json.loads(content)
    content_id = content["id"]
    print(content_id)
    response = requests.get(url_config)

    if response.status_code == 200:
        try:
            data = response.json()              # Parse JSON body
        except ValueError:
            print("Response was not valid JSON:")
    else:
        print(f"Error {response.status_code}: {response.text}")

    db_id = data["knowledge"]["dbs"][0]["db_id"]
    print(db_id)


    params = {"content_id":content_id,
                "db_id":db_id}

    url_content = f"{url_contents}/{content_id}"
    print(url_content)
    response = requests.delete(url_content, params=params)
    if response.status_code != 200:
        print(f"Request failed ({response.status_code}): {response.text}")
    else:
        print("Knowledge removed successfully")
# ---------- end py3 ----------
out = ClusterOutput(py3)

# ==== cluster Memory_read: read memory content
memory_string = ClusterInput()
data_key = ClusterInput()
python_3_script = Python3Script(memory_string=memory_string, data_key=data_key)  # -> out, iteration, data; inputs memory_string: String, data_key: String
# ---------- python_3_script: Python ----------
#! python 3
# venv: gh_agno

import json




memory_dict = json.loads(memory_string)


memory_str = memory_dict.get("memory", None)

if memory_str:
    memory = json.loads(memory_str)
    iteration = memory.get("iteration", None)

    data = memory.get(data_key, None)

    data = json.dumps(data)
# ---------- end python_3_script ----------
iteration = ClusterOutput(python_3_script.iteration)
data = ClusterOutput(python_3_script.data)
