# Grasshopper definition gh_script_v4.gh (Grasshopper 1.0.8)
# Copyright: MIT License © 2025 M. Johanes
# plug-ins: Human

agent_list = Agent_list(enable=Toggle(True))  # -> out, agents
panel = Panel(agent_list.agents)
session_create = Session_create(user_id="mjohanes@user.id", enable=Toggle(False))
panel_2 = Panel(session_create)

facade = GeometryPipeline(
    GroupByLayer=False,
    GroupByType=False,
    IncludeHidden=True,
    IncludeLocked=True,
    LayerFilter="facade",
    NameFilter="*",
    SublayerFiltering=True,
    TypeFilter=1073741848)
srf = Surface(facade)

building = GeometryPipeline(
    GroupByLayer=False,
    GroupByType=False,
    IncludeHidden=True,
    IncludeLocked=True,
    LayerFilter="building",
    NameFilter="*",
    SublayerFiltering=True,
    TypeFilter=4)
windows = GeometryPipeline(
    GroupByLayer=False,
    GroupByType=False,
    IncludeHidden=True,
    IncludeLocked=True,
    LayerFilter="windows",
    NameFilter="*",
    SublayerFiltering=True,
    TypeFilter=4)
entrance = GeometryPipeline(
    GroupByLayer=False,
    GroupByType=False,
    IncludeHidden=True,
    IncludeLocked=True,
    LayerFilter="entrance",
    NameFilter="*",
    SublayerFiltering=True,
    TypeFilter=4)
floors = GeometryPipeline(
    GroupByLayer=False,
    GroupByType=False,
    IncludeHidden=True,
    IncludeLocked=True,
    LayerFilter="floor",
    NameFilter="*",
    SublayerFiltering=True,
    TypeFilter=4)
crv = Curve(building)
crv_2 = Curve(windows)
crv_3 = Curve(entrance)
crv_4 = Curve(floors)
to_json = To_json(geometry=crv, name="building")
to_json_2 = To_json(geometry=crv_2, name="window")
to_json_3 = To_json(geometry=crv_3, name="entrance")
to_json_4 = To_json(geometry=crv_4, name="floor")
merge = Merge(Data1=to_json, Data2=to_json_4, Data3=to_json_2, Data4=to_json_3)

# ---- group: SESSION LIST
session_list = Session_list(enable=Toggle(False))  # -> out, sessions
panel_3 = Panel(session_list.sessions)

# ---- group: SESSION REMOVE
session_delete = Session_delete(sessions=session_list.sessions, enable=Toggle(False))
panel_4 = Panel(session_delete)

# ---- group: KNOWLEDGE UPLOAD
panel_5 = Panel("base knowledge for design reasoning of edge-computing facade integration")
file_path = FilePath("/Users/mjohanes/PythonProject/gh_aiagents/knowledge/edge_computing_facade.md")
knowledge_upload = Knowledge_upload(filepath=file_path, name="ede-computing facade design integration", description=panel_5, enable=Toggle(False))  # -> out, response
panel_6 = Panel(knowledge_upload.response)

# ---- group: KNOWLEDGE AGENT
agent_runs = Agent_runs(agent_id="knowledge-agent", message="tell me about the type of energy module in facade", enable=Toggle(False))  # -> out, session_id_2, response
panel_7 = Panel(agent_runs.response)

# ---- group: KNOWLEDGE LIST
knowledge_list = Knowledge_list(enable=Toggle(False))  # -> out, contents
panel_8 = Panel(knowledge_list.contents)

# ---- group: MEMORY EXPLORE
toggle = BooleanToggle(True)
number_slider = Slider(4, range=0..5)
list_memories = List_memories(user_id="mjohanes@user.id", topic="generated_grid", enable=toggle)  # -> out, memories
list_memories_2 = List_memories(user_id="mjohanes@user.id", topic="evaluation", enable=toggle)  # -> out, memories
panel_9 = Panel(list_memories.memories)
item = ListItem(List=list_memories.memories, Index=number_slider, Wrap=True)
item_2 = ListItem(List=list_memories_2.memories, Index=number_slider, Wrap=True)
py3 = Python3Script(memory_string=item, data_key="generated_grid")  # -> out, iteration, data; inputs memory_string: String, data_key: String
# ---------- py3: Python ----------
#! python 3
# venv: gh_agno

import json




memory_dict = json.loads(memory_string)


memory_str = memory_dict.get("memory", None)

if memory_str:
    memory = json.loads(memory_str)
    iteration = memory.get("iteration", None)

    data = memory.get(data_key, None)

    data = json.dumps(data)
# ---------- end py3 ----------
py3_2 = Python3Script(memory_string=item_2, data_key="evaluation")  # -> out, iteration, data; inputs memory_string: String, data_key: String
# ---------- py3_2: Python ----------
#! python 3
# venv: gh_agno
import json




memory_dict = json.loads(memory_string)


memory_str = memory_dict.get("memory", None)

if memory_str:
    memory = json.loads(memory_str)
    iteration = memory.get("iteration", None)

    data = memory.get(data_key, None)

    data = json.dumps(data)
# ---------- end py3_2 ----------
panel_10 = Panel(py3.data)
panel_11 = Panel(py3.iteration)
panel_12 = Panel(py3_2.iteration)
panel_13 = Panel(py3_2.data)

# ---- group: KNOWLEDGE REMOVE
list_item = ListItem(List=knowledge_list.contents, Index=0, Wrap=True)
remove_knowledge = Remove_knowledge(content=list_item, enable=Toggle(False))
panel_14 = Panel(remove_knowledge)

# ---- group: KNOWLEDGE REMOVE ALL
knowledge_rem_all = Knowledge_rem_all(enable=Toggle(False))
panel_15 = Panel(knowledge_rem_all)

# ----
py3_3 = Python3Script(input_jsons=py3.data)  # -> out, grid_lines; inputs input_jsons: String
# ---------- py3_3: Python ----------
#! python 3
# venv: gh_agno

import Rhino.Geometry as rg
from schema.rhino_converters import to_rhino
from schema.geometry import Line
import json, requests
from ghpythonlib import treehelpers as th

grid_lines = []
if input_jsons:
    grid_json = json.loads(input_jsons)
    lines = grid_json.get("lines", [])
    for l in lines:
        grid_lines.append(Line.model_validate(l))


grid_lines = [to_rhino(l) for l in grid_lines]
# ---------- end py3_3 ----------
number_slider_2 = Slider(0.2, range=0..1)
ext = ExtendCurve(Curve=py3_3.grid_lines, Type=0, Start=number_slider_2, End=number_slider_2)
boundary = BoundarySurfaces(Edges=crv)
crv_5 = Curve(ext)
srfsplit = SurfaceSplit(Surface=boundary, Curves=crv_5)

area = Area(Geometry=srfsplit)  # -> flatten(Area), flatten(Centroid)
edges = BrepEdges(Brep=srfsplit)  # -> Naked, Interior, NonManifold
json_create = Json_create(key="area", val=area.Area)  # -> flatten(jsons)
join = JoinCurves(Curves=edges.Naked, Preserve=False)  # -> flatten(Curves)
to_json_5 = To_json(geometry=join, name="grid_panel")  # -> flatten(json_2)

panel_16 = Panel("""0.5
0.1
0.2
0.1""")
dash = DashPattern(Curve=crv_5, Pattern=panel_16)  # -> Dashes, Gaps
previewlw = CustomPreviewLineweights(
    Geometry=dash.Dashes,
    Shader=ColourSwatch(SwatchColor=RGB(148, 148, 148)),
    Thickness=Slider(0.01, range=0..0.01),
    Absolute=True)

py3_4 = Python3Script(crv=join)  # -> out, compactness; inputs crv: Curve
# ---------- py3_4: Python ----------
#! python 3
# venv: gh_agno

# Inputs: crv (Rhino.Geometry.Curve) — closed & planar
import Rhino.Geometry as rg
import math

if not crv or not crv.IsClosed:
    raise ValueError("Curve must be closed.")
if not crv.IsPlanar():
    # Fit a best plane and project the curve to it
    rc, plane = crv.TryGetPlane()
    if not rc:
        raise ValueError("Curve is not planar; cannot compute area.")
else:
    rc, plane = crv.TryGetPlane()
    if not rc:
        plane = rg.Plane.WorldXY

# Perimeter
P = crv.GetLength()
print(P)

# Area (planar closed curve)
amp = rg.AreaMassProperties.Compute(crv)
if not amp:
    raise ValueError("Area computation failed.")
A = amp.Area

# Isoperimetric compactness in [0,1]
compactness = 4.0 * math.pi * A / (P * P)
# ---------- end py3_4 ----------
get_domain = GetDomain(number=area.Area)
get_domain_2 = GetDomain(number=py3_4.compactness)
remap = RemapNumbers(Value=area.Area, Source=get_domain, Target=Domain(0, 1))  # -> Mapped, Clipped
remap_2 = RemapNumbers(Value=py3_4.compactness, Source=get_domain_2, Target=Domain(0, 1))  # -> Mapped, Clipped
frgb = ColourRGBF(Alpha=1, Red=remap.Mapped, Green=remap_2.Mapped, Blue=Slider(1, range=0..1))
preview = CustomPreview(Geometry=srfsplit, Material=frgb)

lng = ListLength(List=area.Centroid)
series = Series(Start=Slider(1, range=0..1), Step=1, Count=lng)
xz = XZPlane(Origin=area.Centroid)
tag = TextTag3D(Location=xz, Text=series, Size=Slider(0.1, range=0..1), Colour=ColourSwatch(SwatchColor=RGB(0, 0, 0)), Justification=5)

py3_5 = Python3Script(grid_panels=join, areas=area.Area, centroids=area.Centroid, jsons=to_json_5)  # -> out, graph; inputs grid_panels: list of Polyline, areas: list, centroids: list of Point3d, jsons: list of String
# ---------- py3_5: Python ----------
#! python 3
# venv: gh_agno
# requirements: networkx
"""
Inputs:
    polygons: list of closed Rhino.Geometry.Polyline or Curve
    centroids: list of Rhino.Geometry.Point3d
Outputs:
    G: networkx.Graph adjacency graph
    edges: list of Rhino.Geometry.Line connecting adjacent polygons
"""

import Rhino.Geometry as rg
import networkx as nx
import json

tol = 1e-3

geom_json = [json.loads(s) for s in jsons]
area_rounded = [round(x,2) for x in areas]

# --- Build empty graph ---
G = nx.Graph()

# Add all polygons as nodes with centroid data
for i, c in enumerate(centroids):
    name = geom_json[i]['id']
    polygon = geom_json[i]['points']
    c = (round(c.X, 2), round(c.Y, 2), round(c.Z, 2))
    a = area_rounded[i]
    G.add_node(name, centroid=c, area=a)

def edge_based_adj(p1, p2, tol=1e-6):
    """
    Return True if polygons share an edge (overlap length > tol)
    """
    # Convert to PolylineCurve if needed
    crv1 = rg.PolylineCurve(p1) if isinstance(p1, rg.Polyline) else p1
    crv2 = rg.PolylineCurve(p2) if isinstance(p2, rg.Polyline) else p2

    # Get individual segments
    segs1 = [rg.LineCurve(s) for s in crv1.TryGetPolyline()[1].GetSegments()] if crv1.TryGetPolyline()[0] else [crv1]
    segs2 = [rg.LineCurve(s) for s in crv2.TryGetPolyline()[1].GetSegments()] if crv2.TryGetPolyline()[0] else [crv2]

    # Compare each segment pair
    for s1 in segs1:
        for s2 in segs2:
            inter = rg.Intersect.Intersection.CurveCurve(s1, s2, tol, tol)
            if inter:
                for ev in inter:
                    if ev.OverlapA and ev.OverlapA.Length > tol:
                        return True
    return False


def to_point3d(p):
    if isinstance(p, rg.Point3d):
        return p
    elif isinstance(p, (tuple, list)) and len(p) == 3:
        return rg.Point3d(p[0], p[1], p[2])
    else:
        raise TypeError("Invalid centroid type: {}".format(type(p)))


# --- Build edges based on shared boundaries ---
n = len(grid_panels)
for i in range(n):
    for j in range(i + 1, n):
        if edge_based_adj(grid_panels[i], grid_panels[j], tol):
            G.add_edge(geom_json[i]['id'], geom_json[j]['id'])




graph = G
# ---------- end py3_5 ----------
py3_6 = Python3Script(G=py3_5.graph, entrances=crv_3, windows=crv_2)  # -> out, G; inputs entrances: list of Curve, windows: list of Curve
# ---------- py3_6: Python ----------
#! python 3
# venv: gh_agno
# requirements: networkx
import Rhino.Geometry as rg
import rhinoscriptsyntax as rs

tol = 0.001
G = G.copy()

# --- Helper function ----------------------------------------------------------
def point_in_any_surface(pt, breps, tol=1e-3):
    """Check if a 3D point is inside or on any planar Brep in the list."""
    for brep in breps:
        is_planar, plane = brep.TryGetPlane()
        if not is_planar:
            continue
        projected = plane.ClosestPoint(pt)
        rel = brep.Contains(projected, plane)
        if rel in (rg.PointContainment.Inside,):
            return True
    return False

# --- Main loop ---------------------------------------------------------------
for u, d in G.nodes(data=True):
    pt = rg.Point3d(*d['centroid'])

    has_window = point_in_any_surface(pt, windows, tol)
    has_entrance = point_in_any_surface(pt, entrances, tol)

    # set attributes only when true
    if has_window:
        G.nodes[u]["has_window"] = True
    if has_entrance:
        G.nodes[u]["has_entrance"] = True
# ---------- end py3_6 ----------
py3_7 = Python3Script(G=py3_6.G)  # -> out, edges, nodes
# ---------- py3_7: Python ----------
#! python 3
# venv: gh_agno
# requirements: networkx

import Rhino.Geometry as rg

# --- Visualization lines between centroids ---
edges = []
for i, j in G.edges():
    p1, p2 = G.nodes[i]["centroid"], G.nodes[j]["centroid"]
    # Make sure both are valid Rhino points
    if isinstance(p1, (tuple, list)): p1 = rg.Point3d(*p1)
    if isinstance(p2, (tuple, list)): p2 = rg.Point3d(*p2)
    edges.append(rg.Line(p1, p2))

nodes = []
for u, d in G.nodes(data=True):
    p = rg.Point3d(*d['centroid'])
    sphere = rg.Sphere(p, d['area']**0.5/10)
    nodes.append(sphere)


for u, d in G.nodes(data=True):
    print(d)
# ---------- end py3_7 ----------
py3_8 = Python3Script(G=py3_6.G)  # -> out, graph_jsons
# ---------- py3_8: Python ----------
#! python 3
# venv: gh_agno
# requirements: networkx

import Rhino.Geometry as rg
import json
from networkx.readwrite import json_graph   



data = json_graph.node_link_data(G)



graph_jsons = json.dumps(data)
# ---------- end py3_8 ----------

list_memories_3 = List_memories(user_id="mjohanes@user.id", topic="facade_concept", enable=Toggle(True))  # -> out, memories
panel_17 = Panel(list_memories_3.memories)
item_3 = ListItem(List=list_memories_3.memories, Index=Slider(1, range=0..5), Wrap=True)
py3_9 = Python3Script(memory_string=item_3, data_key="memory")  # -> out, iteration, memory_str; inputs memory_string: String, data_key: String
# ---------- py3_9: Python ----------
#! python 3
# venv: gh_agno
import json




memory_dict = json.loads(memory_string)


memory_str = memory_dict.get("memory", None)
# ---------- end py3_9 ----------
panel_18 = Panel(py3_9.memory_str)

panel_19 = Panel("""Create a futuristic facade system that integrates edge-computing capabilities, using the provided facade element masks and their associated concepts.
Preserve the existing atmospheric quality of the context image.
Use the assigned mask colors only as indices for reference—derive the actual materiality, color, and finish of each panel strictly from its corresponding type and description.""")

dotenv = FilePath("/Users/mjohanes/PythonProject/gh_agno_agents/")
path = FilePath("/Users/mjohanes/Downloads/")
picsrc = PictureSource(PictureSurface=srf)
bbox = BoundingBox(Content=srf, Plane=PlaneXY(0, 0, 0))  # -> Box, Box_2
bbox_2 = BoundingBox(Content=crv, Plane=PlaneXY(0, 0, 0))  # -> Box, Box_2
debox = DeconstructBox(Box=bbox.Box)  # -> Plane, X, Y, Z
debox_2 = DeconstructBox(Box=bbox_2.Box)  # -> Plane, X, Y, Z
panel_20 = Panel(path)
py3_10 = Python3Script(
    user_prompt=panel_19,
    facade_design=py3_9.memory_str,
    facade_panels=join,
    image_path=picsrc,
    img_x=debox.X,
    img_y=debox.Z)  # -> out, img_bytes, img_names, prompt; inputs facade_panels: list of Curve
# ---------- py3_10: Python ----------
#! python 3
# venv: gh_agno
# requirements: pillow

from PIL import Image, ImageDraw
from io import BytesIO
import os
import json
from ghpythonlib import treehelpers as th
import Rhino.Geometry as rg
from shapely.geometry import Polygon, MultiPolygon
import shapely as sh
from shapely.affinity import scale, translate


# ------------------------------------------------------------
# RHINO → SHAPELY conversion
# ------------------------------------------------------------
def rhino_to_shapely(rhino_curve, normalize=False, precision=None):
    if isinstance(rhino_curve, rg.Polyline):
        pts = [(pt.X, pt.Z) for pt in rhino_curve]

    elif isinstance(rhino_curve, rg.PolylineCurve):
        polyline = rhino_curve.ToPolyline()
        pts = [(pt.X, pt.Z) for pt in polyline]

    else:
        polyline = rhino_curve.ToPolyline(0.01, 0.01, 0.01, 0.01)
        pts = [(pt.X, pt.Z) for pt in polyline]

    poly = Polygon(pts)

    if normalize:
        poly = poly.normalize()
    if precision is not None:
        poly = sh.set_precision(poly, precision)

    return poly


# ------------------------------------------------------------
# SHAPELY geometric helpers
# ------------------------------------------------------------
def move_geometry_to(geom, new_x0=0, new_y0=0):
    minx, miny, _, _ = geom.bounds
    return translate(geom, xoff=-new_x0, yoff=-new_y0)


def metric_to_pixel(geom, metric_width, pixel_width, pixel_height, anchor_min=False, flip_y=True):
    minx, miny, maxx, maxy = geom.bounds
    sx = pixel_width / metric_width
    sy = sx

    g = geom
    if anchor_min:
        g = translate(g, xoff=-minx, yoff=-miny)

    g = scale(g, xfact=sx, yfact=sy, origin=(0, 0))

    if flip_y:
        g = scale(g, xfact=1, yfact=-1, origin=(0, pixel_height / 2))

    return g


# ------------------------------------------------------------
# DRAW MASKS in custom RGB colors
# ------------------------------------------------------------
def shapely_to_mask_rgb(polys, width, height, fill_color, bg_color=(255, 255, 255)):
    img = Image.new("RGB", (width, height), bg_color)
    draw = ImageDraw.Draw(img)

    for poly in polys:
        sub_polys = list(poly.geoms) if isinstance(poly, MultiPolygon) else [poly]

        for p in sub_polys:
            exterior = [(x, y) for x, y in p.exterior.coords]
            draw.polygon(exterior, fill=fill_color)

            # Holes
            for hole in p.interiors:
                hole_coords = [(x, y) for x, y in hole.coords]
                draw.polygon(hole_coords, fill=bg_color)

    return img


# ------------------------------------------------------------
# OVERLAY FOR VISUALIZATION
# ------------------------------------------------------------
def overlay_mask_on_image(base_img, mask_img, alpha=0.7):
    base = base_img.convert("RGBA")
    mask = mask_img.convert("RGBA")

    r, g, b= mask_img.split()
    # full alpha for filled regions
    # mask_alpha = r.point(lambda v: int(alpha * 255 if v > 0 else 0))
    mask_alpha = Image.merge("RGB", (r, g, b)).convert("L").point(lambda v: int(alpha * 255 if v > 0 else 0))

    mask = Image.merge("RGBA", (r, g, b, mask_alpha))
    
    return Image.alpha_composite(base, mask).convert("RGB")


# ------------------------------------------------------------
# PROMPT BUILDER (now includes colors)
# ------------------------------------------------------------
def build_facade_prompt(typologies, concepts, user_prompt, colors):
    masks_text = ""
    for idx, (t, c, col) in enumerate(zip(typologies, concepts, colors)):
        rgb, color_name = col
        mask_filename = f"facade_element_{idx+1:02d}.png"
        masks_text += f"""
{idx+1}) {mask_filename}
   type: {t}
   color index: {color_name} (RGB {rgb})
   description: {c}
"""

    prompt = f"""
TASK:
Generate a new facade system using the provided colored panel masks.

Each mask has a distinct color for clear reference.

FACADE ELEMENTS:
{masks_text}

INSTRUCTIONS:
{user_prompt}
"""
    return prompt.strip()


# ------------------------------------------------------------
# LLM-friendly vivid color palette
# ------------------------------------------------------------
LLM_COLOR_PALETTE = [
    ((255,   0,   0), "red"),
    ((  0, 0, 255), "blue"),
    ((255, 255,   0), "yellow"),
    ((  0, 255, 0), "green"),
    ((255,   0, 255), "magenta"),
    ((255, 128,   0), "orange"),
    ((128,   0, 255), "violet"),
    ((255,  20, 147), "pink"),
    ((  0, 255, 255), "cyan"),
    ((128, 255,   0), "lime"),
]


# ------------------------------------------------------------
# LOAD DESIGN SPEC
# ------------------------------------------------------------
design_dict = json.loads(facade_design)
facade_concept = design_dict.get("concept", None)
facades = design_dict.get("facade", None)

typologies = []
concepts = []
panels = []

for facade in facades:
    typologies.append(facade.get("typology", None))
    concepts.append(facade.get("concept", None))
    panel_id = facade.get("elements", [])
    panel_idx = [int(p.split('-')[-1]) - 1 for p in panel_id]
    panels.append(panel_idx)


# ------------------------------------------------------------
# GEOMETRY PROCESSING
# ------------------------------------------------------------
facade_panels = [rhino_to_shapely(c) for c in facade_panels]
facade_panels = [move_geometry_to(c, new_x0=img_x[0], new_y0=img_y[0]) for c in facade_panels]

img = Image.open(image_path)
img.thumbnail((1024, 1024), Image.LANCZOS)

metric_width = img_x[1] - img_x[0]
w, h = img.size

facade_panels = [metric_to_pixel(c, metric_width, w, h) for c in facade_panels]


# ------------------------------------------------------------
# MASK GENERATION
# ------------------------------------------------------------
mask_bytes = []
mask_titles = []
color_for_masks = []  # store (RGB, name) for prompt

for i, panel in enumerate(panels):
    # assign unique color
    rgb, color_name = LLM_COLOR_PALETTE[i % len(LLM_COLOR_PALETTE)]
    color_for_masks.append((rgb, color_name))

    # collect polygons
    panel_polys = [facade_panels[j] for j in panel]

    # create mask image
    mask_img = shapely_to_mask_rgb(panel_polys, w, h, fill_color=rgb)

    # overlay for visualization
    overlay = overlay_mask_on_image(img, mask_img, alpha=0.6)

    buf = BytesIO()
    overlay.save(buf, format="png")
    mask_bytes.append(buf.getvalue())

    mask_titles.append(f"facade_element_{i+1:02d}.png")


# ------------------------------------------------------------
# FINAL OUTPUT
# ------------------------------------------------------------
img_names = []
img_bytes = []

img_bytes.extend(mask_bytes)
img_names.extend(mask_titles)

prompt = build_facade_prompt(typologies, concepts, user_prompt, color_for_masks)

# GH Python component: assign your outputs here
# OUT_MASK_IMAGES = img_bytes
# OUT_MASK_NAMES  = img_names
# OUT_PROMPT      = prompt
# ---------- end py3_10 ----------
item_4 = ListItem(List=py3_10.img_bytes, Index=Slider(0, range=0..9), Wrap=True)
py3_11 = Python3Script(x=item_4)  # -> out, a
# ---------- py3_11: Python ----------
import base64
b64 = base64.b64encode(x).decode("ascii")



a = b64
# ---------- end py3_11 ----------
py3_12 = Python3Script(
    dotenv_dir=dotenv,
    img_bytes=py3_10.img_bytes,
    img_names=py3_10.img_names,
    prompt=py3_10.prompt,
    save_folder=path,
    enable=Toggle(False))  # -> out, img_path; inputs img_bytes: list, img_names: list, prompt: String, enable: Boolean
# ---------- py3_12: Python ----------
#! python 3
# venv: gh_agno
# requirements: dotenv
# requirements: openai
# requirements: filetype

import os
import base64
from openai import OpenAI
from dotenv import load_dotenv
import io
import uuid
import filetype

# Load .env
dotenv_path = os.path.join(dotenv_dir, ".env")
load_dotenv(dotenv_path)

api_key = os.getenv("OPENAI_API_KEY", "")

# Detect MIME types of your images
mimes = [filetype.guess(b).mime for b in img_bytes]

# Prepare image refs as (name, bytes, mime)
referenced = [
    (name, b, mime)
    for name, b, mime in zip(img_names, img_bytes, mimes)
]

client = OpenAI(api_key=api_key)

print(len(referenced))

if enable:

    random_id = str(uuid.uuid4())

    # Build the input payload (as required by Responses API)
    content_items = [
        {"type": "input_text", "text": prompt}
    ]

    # Add each image as an "input_image"
    for name, img_b, mime in referenced:
        content_items.append({
            "type": "input_image",
            "image_url": f"data:{mime};base64,{base64.b64encode(img_b).decode()}"
        })

    # Make the Responses API call
    response = client.responses.create(
        model="gpt-5.1",
        input=[{
            "role": "user",
            "content": content_items
        }],
        tools=[{"type": "image_generation"}],
    )

    # Extract image edit output
    image_edit_calls = [
        output
        for output in response.output
        if output.type == "image_generation_call"
    ]

    image_data = [output.result for output in image_edit_calls]

    if image_data:
        image_base64 = image_data[0]
        image_bytes = base64.b64decode(image_base64)

        img_path = os.path.join(save_folder, f"{random_id}.png")
        with open(img_path, "wb") as f:
            f.write(image_bytes)

        print("Saved:", img_path)
    else:
        print("No image returned. Output:")
        print(response.output)
# ---------- end py3_12 ----------
str2img = DeserializeImageFromString(ImageString=py3_11.a)
image_resource = ImageResource(str2img)
image_resource_2 = ImageResource(py3_12.img_path)

panel_21 = Panel(py3_10.prompt)
panel_22 = Panel(py3_12.out)

# ==== cluster To_json: convert basic rhino geometry to json based representation
name = ClusterInput()
geometry = ClusterInput()
name_2 = Text(name)
geometry_2 = Geometry(geometry)
name_3 = Python3Script(geoms=geometry_2, name=name_2)  # -> out, names; inputs geoms: list, name: String
# ---------- name_3: Python ----------
#! python 3
# venv: gh_agno

names = []
for i in range(len(geoms)):
    names.append(f'{name}-{i+1:02d}')
# ---------- end name_3 ----------
to_json = Python3Script(geometry=geometry_2, name=name_3.names)  # -> out, json_string; inputs geometry: GeometryBase
# ---------- to_json: Python ----------
#! python 3
# venv: gh_agno
# requirements: pydantic

import json
import Rhino.Geometry as rg
from pydantic import ValidationError

# Import your Pydantic geometry schema
from schema.geometry import (
    Geometry,
    Point3d,
    Vector3d,
    Line,
    Plane,
    Polyline,
    Circle,
    Arc,
    Mesh,
    NurbsSurface,
    PlaneSurface,
    RevSurface
)

from schema.from_rhino import *

input_geometry = geometry



def convert_geometry_to_json(input_geometry, name=None):
    """
    Converts Rhino geometry to JSON string using schema.from_rhino.
    Raises:
        ValueError: if input is None
        TypeError: if geometry type is unsupported
    """
    if input_geometry is None:
        raise ValueError("No geometry provided — expected a Rhino.Geometry object.")
    try:
        pydantic_obj = from_rhino(input_geometry)
    except TypeError as e:
        raise TypeError(f"Unsupported geometry type: {type(input_geometry)}") from e
    except Exception as e:
        raise RuntimeError(f"Conversion failed for geometry {input_geometry}: {e}")

    if not isinstance(pydantic_obj, Geometry):
        raise TypeError(f"Conversion did not return a valid Geometry model (got {type(pydantic_obj)}).")

    # inject name:
    if name:
        pydantic_obj = pydantic_obj.model_copy(update={"id": name})
    # Serialize to JSON
    return pydantic_obj.model_dump_json()


try:
    input_geometry = geometry  # from GH Python input
except NameError:
    raise ValueError("Variable 'geometry' not found — define your input first.")

json_string = convert_geometry_to_json(input_geometry, name)
print(json_string)
# ---------- end to_json ----------
json = Text(to_json.json_string)
json_2 = ClusterOutput(json)

# ==== cluster Session_create: create new session id
user_id = ClusterInput()
enable = ClusterInput()
py3 = Python3Script(user_id=user_id, enable=enable)  # -> out, session_id; inputs user_id: String, enable: Boolean
# ---------- py3: Python ----------
#! python 3
# venv: gh_agno
# requirements: requests
import json, requests
from ghpythonlib import treehelpers as th

url_config = "http://127.0.0.1:8000/config"
url_session = "http://127.0.0.1:8000/sessions"

if enable:
    response = requests.get(url_config)

    if response.status_code == 200:
        try:
            data = response.json()              # Parse JSON body
        except ValueError:
            print("Response was not valid JSON:")
    else:
        print(f"Error {response.status_code}: {response.text}")

    db_id = data.get('databases')[0]
    print(db_id)




    params = {
        "type": "agent",
        "db_id": db_id
    }

    payload = {}

    print(user_id)

    if user_id:
        payload["user_id"] = user_id

    print(payload)

    response = requests.post(url_session, params=params, json=payload)


    if response.status_code == 201:
        try:
            data = response.json()              # Parse JSON body
        except ValueError:
            print("Response was not valid JSON:")
    else:
        print(f"Error {response.status_code}: {response.text}")
        

    session_id = data.get("session_id", None)
# ---------- end py3 ----------
session_id = ClusterOutput(py3.session_id)

# ==== cluster Json_create: create key val json
key = ClusterInput()
val = ClusterInput()
python_3_script = Python3Script(key=key, val=val)  # -> out, jsons; inputs key: String, val: String
# ---------- python_3_script: Python ----------
#! python 3
# venv: gh_agno

import json

def format_floats(obj):
    if isinstance(obj, float):
        return round(obj, 2)
    elif isinstance(obj, list):
        return [format_floats(x) for x in obj]
    elif isinstance(obj, dict):
        return {k: format_floats(v) for k, v in obj.items()}
    else:
        return obj


if val:

    try:
        val = json.loads(val)
    except Exception:
        pass
    data = {key: format_floats(val)}
    jsons = json.dumps(data)
# ---------- end python_3_script ----------
jsons = ClusterOutput(python_3_script.jsons)

# ==== cluster Agent_list: list all available agents
enable = ClusterInput()
list_agents = Python3Script(enable=enable)  # -> out, data, agents; inputs enable: Boolean
# ---------- list_agents: Python ----------
#! python 3
# venv: gh_agno
# requirements: requests
import json, requests
from ghpythonlib import treehelpers as th

url = "http://127.0.0.1:8000/agents"


if enable:
    response = requests.get(url)


    if response.status_code == 200:
        try:
            data = response.json()              # Parse JSON body
        except ValueError:
            print("Response was not valid JSON:")
    else:
        print(f"Error {response.status_code}: {response.text}")

    agents = []
    for item in data:
        agents.append(item.get('id', None))


    agents = th.list_to_tree(agents)
# ---------- end list_agents ----------
out = ClusterOutput(list_agents.out)
agents = ClusterOutput(list_agents.agents)

# ==== cluster List_memories: list all memories
topic = ClusterInput()
enable = ClusterInput()
search_content = ClusterInput()
agent_id = ClusterInput()
user_id = ClusterInput()
py3 = Python3Script(user_id=user_id, agent_id=agent_id, search_content=search_content, topic=topic, enable=enable)  # -> out, memories; inputs topic: String, enable: Boolean
# ---------- py3: Python ----------
#! python 3
# venv: gh_agno
# requirements: requests
import json, requests
from ghpythonlib import treehelpers as th


url_config = "http://127.0.0.1:8000/config"
url_memories = "http://127.0.0.1:8000/memories"

if enable:
    response = requests.get(url_config)

    if response.status_code == 200:
        try:
            data = response.json()              # Parse JSON body
        except ValueError:
            print("Response was not valid JSON:")
    else:
        print(f"Error {response.status_code}: {response.text}")

    db_id = data.get('databases')[0]
    print(db_id)


    params = {}

    if user_id:
        params["user_id"] = user_id

    if agent_id:
        params["agent_id"] = agent_id

    if search_content:
        params["search_content"] = search_content

    if topic:
        params["topics"]=[topic]
    
    params["db_id"] = db_id
    params["limit"] = 20
    params["page"] = 1
    params["sort_by"] = "updated_at"
    params["sort_order"] = "desc"


    # Make the GET request
    all_memories = []

    while True:
        response = requests.get(url_memories, params=params)


        if response.status_code != 200:
            print(f"Request failed ({response.status_code}): {response.text}")
            break
        

        data = response.json()
        items = data.get("data", [])
        meta = data.get("meta", {})


        if not items:
            print("No more memories found.")
            break

        
        all_memories.extend(items)

        total_pages = meta.get("total_pages", 0)
        current_page = meta.get("page", params["page"])

        # Stop when we reach the last page
        if current_page >= total_pages:
            break

        # Move to next page
        params["page"] = current_page + 1

    print(all_memories)


    memories = [json.dumps(d) for d in all_memories]
# ---------- end py3 ----------
memories = ClusterOutput(py3.memories)
out = ClusterOutput(py3.out)

# ==== cluster GetDomain
number = ClusterInput()
number_2 = Number(number)
sort_list = SortList(Keys=number_2)  # -> Keys, ValuesValuesA
list_item = ListItem(List=sort_list.Keys, Index=0, Wrap=True)
list_item_2 = ListItem(List=sort_list.Keys, Index=-1, Wrap=True)
construct_domain = ConstructDomain(DomainStart=list_item, DomainEnd=list_item_2)
domain = ClusterOutput(construct_domain)

# ==== cluster Session_list: list all sessions
user_id = ClusterInput()
enable = ClusterInput()
py3 = Python3Script(user_id=user_id, enable=enable)  # -> out, sessions; inputs enable: Boolean
# ---------- py3: Python ----------
#! python 3
# venv: gh_agno
# requirements: requests
import json, requests
from ghpythonlib import treehelpers as th


url_config = "http://127.0.0.1:8000/config"
url_sessions = "http://127.0.0.1:8000/sessions"

if enable:
    response = requests.get(url_config)

    if response.status_code == 200:
        try:
            data = response.json()              # Parse JSON body
        except ValueError:
            print("Response was not valid JSON:")
    else:
        print(f"Error {response.status_code}: {response.text}")

    db_id = data.get('databases')[0]
    print(db_id)


    params = {"type":"agent"}

    if user_id:
        params["user_id"] = user_id

    
    params["db_id"] = db_id
    params["limit"] = 20
    params["page"] = 1
    params["sort_by"] = "updated_at"
    params["sort_order"] = "desc"


    # Make the GET request
    all_sessions = []

    while True:
        response = requests.get(url_sessions, params=params)


        if response.status_code != 200:
            print(f"Request failed ({response.status_code}): {response.text}")
            break
        

        data = response.json()
        items = data.get("data", [])
        meta = data.get("meta", {})


        if not items:
            print("No more session found.")
            break

        
        all_sessions.extend(items)

        total_pages = meta.get("total_pages", 0)
        current_page = meta.get("page", params["page"])

        # Stop when we reach the last page
        if current_page >= total_pages:
            break

        # Move to next page
        params["page"] = current_page + 1

    # print(all_memories)


    sessions = [json.dumps(d) for d in all_sessions]
# ---------- end py3 ----------
out = ClusterOutput(py3.out)
sessions = ClusterOutput(py3.sessions)

# ==== cluster Session_delete: delete sessions
sessions = ClusterInput()
enable = ClusterInput()
py3 = Python3Script(sessions=sessions, enable=enable)  # -> out; inputs sessions: list of String, enable: Boolean
# ---------- py3: Python ----------
#! python 3
# venv: gh_agno
# requirements: requests
import json, requests
from ghpythonlib import treehelpers as th


url_config = "http://127.0.0.1:8000/config"
url_sessions = "http://127.0.0.1:8000/sessions"

if enable:
    response = requests.get(url_config)

    if response.status_code == 200:
        try:
            data = response.json()              # Parse JSON body
        except ValueError:
            print("Response was not valid JSON:")
    else:
        print(f"Error {response.status_code}: {response.text}")

    db_id = data.get('databases')[0]
    print(db_id)


    params = {"db_id":db_id, "type":"agent"}

    if enable and sessions:
        sessions = [json.loads(m) for m in sessions]
        session_ids = [d["session_id"] for d in sessions]
        session_types = ["agent" for d in sessions]
        
        data={"session_ids":session_ids,
                "session_types":session_types}

        response = requests.delete(url_sessions, params=params, json=data)
        if response.status_code != 204:
            print(f"Request failed ({response.status_code}): {response.text}")
            
        print("Sessions deleted successfully")
# ---------- end py3 ----------
out = ClusterOutput(py3)

# ==== cluster Agent_runs: run an agent
agent_id = ClusterInput()
session_id = ClusterInput()
user_id = ClusterInput()
message = ClusterInput()
enable = ClusterInput()
agent_runs = Python3Script(agent_id=agent_id, session_id=session_id, user_id=user_id, message=message, enable=enable)  # -> out, session_id, response; inputs agent_id: String, user_id: String, message: String, enable: Boolean
# ---------- agent_runs: Python ----------
#! python 3
# venv: gh_agno
# requirements: requests

import Rhino.Geometry as rg
from schema.rhino_converters import to_rhino
from schema.geometry import Line
import json, requests
from ghpythonlib import treehelpers as th

url = f"http://127.0.0.1:8000/agents/{agent_id}/runs"


payload = {}

if enable:
    if message:
        payload["message"]=message
    
    if session_id:
        payload["session_id"]=session_id


    if user_id:
        payload["user_id"]=user_id


    response = requests.post(url, data=payload)

    if response.status_code == 200:
        try:
            data = response.json()              # Parse JSON body
        except ValueError:
            print("Response was not valid JSON:")
    else:
        print(f"Error {response.status_code}: {response.text}")


    session_id = data.get("session_id", None)
    content = data.get("content", None)

    response = json.dumps(content)
# ---------- end agent_runs ----------
response = ClusterOutput(agent_runs.response)
session_id_2 = ClusterOutput(agent_runs.session_id)
out = ClusterOutput(agent_runs.out)

# ==== cluster Knowledge_list: list all knowledge
enable = ClusterInput()
py3 = Python3Script(enable=enable)  # -> out, contents; inputs enable: Boolean
# ---------- py3: Python ----------
#! python 3
# venv: gh_agno
# requirements: requests
import json, requests
from ghpythonlib import treehelpers as th


url_config = "http://127.0.0.1:8000/config"
url_contents = "http://127.0.0.1:8000/knowledge/content"

if enable:
    response = requests.get(url_config)

    if response.status_code == 200:
        try:
            data = response.json()              # Parse JSON body
        except ValueError:
            print("Response was not valid JSON:")
    else:
        print(f"Error {response.status_code}: {response.text}")

    db_id = data["knowledge"]["dbs"][0]["db_id"]
    print(db_id)



    params = {"type":"agent"}


    
    params["db_id"] = db_id
    params["limit"] = 20
    params["page"] = 1
    params["sort_by"] = "created_at"
    params["sort_order"] = "desc"


    # Make the GET request
    all_contents = []

    while True:
        response = requests.get(url_contents, params=params)


        if response.status_code != 200:
            print(f"Request failed ({response.status_code}): {response.text}")
            break
        

        data = response.json()
        items = data.get("data", [])
        meta = data.get("meta", {})


        if not items:
            print("No more contents found.")
            break

        
        all_contents.extend(items)

        total_pages = meta.get("total_pages", 0)
        current_page = meta.get("page", params["page"])

        # Stop when we reach the last page
        if current_page >= total_pages:
            break

        # Move to next page
        params["page"] = current_page + 1

    # print(all_memories)


    contents = [json.dumps(d) for d in all_contents]

    print(contents)
# ---------- end py3 ----------
contents = ClusterOutput(py3.contents)
out = ClusterOutput(py3.out)

# ==== cluster Knowledge_upload: upload file to knowledge base
description = ClusterInput()
enable = ClusterInput()
name = ClusterInput()
filepath = ClusterInput()
py3 = Python3Script(filepath=filepath, name=name, description=description, enable=enable)  # -> out, response; inputs filepath: String, enable: Boolean
# ---------- py3: Python ----------
#! python 3
# venv: gh_agno
# requirements: requests
import os
import json, requests
from ghpythonlib import treehelpers as th
import mimetypes



url_config = "http://127.0.0.1:8000/config"
url_contents = "http://127.0.0.1:8000/knowledge/content"

if enable and filepath:
    response = requests.get(url_config)

    if response.status_code == 200:
        try:
            data = response.json()              # Parse JSON body
        except ValueError:
            print("Response was not valid JSON:")
    else:
        print(f"Error {response.status_code}: {response.text}")

    db_id = data["knowledge"]["dbs"][0]["db_id"]
    print(db_id)



    params = {"db_id":db_id}

    payload = {}
    if name:
        payload["name"]=name


    mime_type, _ = mimetypes.guess_type(filepath)
    if mime_type is None:
        mime_type = "application/octet-stream" 
    
    print(mime_type)
    # open the file you want to upload
    with open(filepath, "rb") as f:
        filename = os.path.basename(filepath)
        files = {
            "file": (filename, f, mime_type)  # (filename, file object)
        }

        data = {
            "name": "",
            "description": "",
            "url": "",
            "metadata": "",
            "text_content": "",
            "reader_id": "",
            "chunker": "",
        }

        if name:
            data["name"] = name
        if description:
            data["description"] = description

        headers = {
            "accept": "application/json",
        }

        response = requests.post(url_contents, params=params, headers=headers, data=data, files=files)

    print(response.status_code)
    print(response.json())
# ---------- end py3 ----------
out = ClusterOutput(py3.out)
response = ClusterOutput(py3.response)

# ==== cluster Knowledge_rem_all: remove all content in knowledge base
enable = ClusterInput()
py3 = Python3Script(enable=enable)  # -> out; inputs enable: Boolean
# ---------- py3: Python ----------
#! python 3
# venv: gh_agno
# requirements: requests
import json, requests
from ghpythonlib import treehelpers as th


url_config = "http://127.0.0.1:8000/config"
url_contents = "http://127.0.0.1:8000/knowledge/content"

if enable:
    response = requests.get(url_config)

    if response.status_code == 200:
        try:
            data = response.json()              # Parse JSON body
        except ValueError:
            print("Response was not valid JSON:")
    else:
        print(f"Error {response.status_code}: {response.text}")

    db_id = data["knowledge"]["dbs"][0]["db_id"]
    print(db_id)


    params = {"db_id":db_id}


    response = requests.delete(url_contents, params=params)
    if response.status_code != 200:
        print(f"Request failed ({response.status_code}): {response.text}")
        
    print("Knowledge removed successfully")
# ---------- end py3 ----------
out = ClusterOutput(py3)

# ==== cluster Remove_knowledge: remove selected knowledge content
content = ClusterInput()
enable = ClusterInput()
py3 = Python3Script(content=content, enable=enable)  # -> out; inputs content: String, enable: Boolean
# ---------- py3: Python ----------
#! python 3
# venv: gh_agno
# requirements: requests
import json, requests
from ghpythonlib import treehelpers as th


url_config = "http://127.0.0.1:8000/config"
url_contents = "http://127.0.0.1:8000/knowledge/content"

if enable and content:

    content = json.loads(content)
    content_id = content["id"]
    print(content_id)
    response = requests.get(url_config)

    if response.status_code == 200:
        try:
            data = response.json()              # Parse JSON body
        except ValueError:
            print("Response was not valid JSON:")
    else:
        print(f"Error {response.status_code}: {response.text}")

    db_id = data["knowledge"]["dbs"][0]["db_id"]
    print(db_id)


    params = {"content_id":content_id,
                "db_id":db_id}

    url_content = f"{url_contents}/{content_id}"
    print(url_content)
    response = requests.delete(url_content, params=params)
    if response.status_code != 200:
        print(f"Request failed ({response.status_code}): {response.text}")
    else:
        print("Knowledge removed successfully")
# ---------- end py3 ----------
out = ClusterOutput(py3)
